# Grasshopper definition SpacePartition.gh (Grasshopper 1.0.7)
# plug-ins: FloorsAndVolumes, PTComponentLibrary

number_slider = Slider(9, range=0..10)
number_slider_2 = Slider(4, range=0..5)

# ---- group: NumberOfPoints
number_slider_3 = Slider(5, range=0..10)

# ----
dom = ConstructDomain(DomainStart=expr("-x", 0), DomainEnd=1)
dom_2 = ConstructDomain(DomainStart=expr("-x", number_slider), DomainEnd=number_slider)
dom_3 = ConstructDomain(DomainStart=expr("-x", number_slider_2), DomainEnd=number_slider_2)
genemodifier = GenePoolModifier(GeneList="SeedsX", Count=number_slider_3, Domain=dom)
genemodifier_2 = GenePoolModifier(GeneList="SeedsY", Count=number_slider_3, Domain=dom)
rectangle = Rectangle(Plane=PlaneXY(0, 0, 0), XSize=dom_3, YSize=dom_2, Radius=0)  # -> Rectangle, Length
seedsy = GenePool(Decimals=2, Maximum=1, Minimum=0, Value=[0.09198104222, 0.5104235017, 0.7120720352, 0.7119994097, 0.3506903971])
seedsx = GenePool(Decimals=2, Maximum=1, Minimum=0, Value=[0.8127365018, 0.8011794196, 0.8323536314, 0.977401996, 0.7570219076])
crv = Curve(rectangle.Rectangle)
number_slider_4 = Slider(10, range=0..100)
range = Range(Domain=dom_2, Steps=number_slider_4)
pt = ConstructPoint(XCoordinate=seedsx, YCoordinate=seedsy, ZCoordinate=0)
ptsrfdomlen = SurfaceDomainLength(Surface=crv, ULength=Slider(2, range=0..5), VLength=Slider(3, range=0..5))
evalsrf = EvaluateSurface(Surface=reparameterize(crv), Point=pt)  # -> Point, Normal, UDirection, VDirection, Frame
graph_mapper = GraphMapper(
    range,
    x0=0,
    x1=1,
    y0=0,
    y1=1,
    amplitude=0.5422115326,
    container_name="Perlin",
    decay=0.9337485433,
    frequency=0.1361756325,
    x_offset=0.5043328404,
    y_offset=0.4760468006)
construct_domain = ConstructDomain(DomainStart=Slider(0, range=0..100), DomainEnd=Slider(2, range=0..10))
pt_2 = Point(evalsrf.Point)
multiplication = Multiplication(A=graph_mapper, B=Slider(1, range=0..10))
voronoi = Voronoi(Points=pt_2, Boundary=rectangle.Rectangle, BruteForceOverride=False)
genepoolmodifier = GenePoolModifier(GeneList="Weights", Count=expr("x+1", number_slider_4), Domain=construct_domain)
knot_vector = KnotVector(Count=expr("x+1", number_slider_4), Degree=Slider(4, range=0..10), Periodic=False)
construct_point = ConstructPoint(XCoordinate=multiplication, YCoordinate=range, ZCoordinate=0)
weights = GenePool(
    Decimals=2,
    Maximum=2,
    Minimum=0,
    Value=[1.445934037, 1.452122288, 1.07, 1.38, 1.974591002, 0.8557235351, 1.370805027, 0.3950044012, 1.618249166, 1.417969741, 0.1801872347])
nurbs_curve_pwk = NurbsCurvePWK(Points=construct_point, Weights=weights, Knots=knot_vector)  # -> Curve, Length, Domain
polyline = PolyLine(Vertices=construct_point, Closed=False)
curve_attraction = CurveAttraction(Grid=ptsrfdomlen, CrvAtts=polyline, Magnitude=Slider(0.473, range=0..1))  # -> Grid, Weights
ptborders = GenerateBorders(Grid=curve_attraction.Grid, PanelShape=0)  # -> simplify(Border)
crv_2 = Curve(flatten(ptborders))
list_item = ListItem(List=crv_2, Index=0, Wrap=True)
area = Area(Geometry=list_item, UseTasks=False)  # -> Area, Centroid
multiplication_2 = Multiplication(A=area.Area, B=Slider(0.5, range=0..1))
c_script = CSharpScript(voronoiIn=voronoi, gridIn=crv_2, areaIn=multiplication_2)  # -> culledGrid, colourTree; inputs voronoiIn: list of Polyline, gridIn: list of Polyline, areaIn: Double
# ---------- c_script: C# usings ----------
using System.Linq;
# ---------- c_script: C# ----------
    var intersections = new DataTree<Curve>();
    var repeated = new DataTree<Polyline>();
    var bools = new DataTree<bool>();

    for( int i = 0; i < voronoiIn.Count; ++i )
    {

      repeated.AddRange(gridIn, new GH_Path(i));

      for( int j = 0; j < gridIn.Count; ++j )
      {

        intersections.AddRange(Curve.CreateBooleanIntersection(voronoiIn[i].ToNurbsCurve(), gridIn[j].ToNurbsCurve(), 1e-7).ToList(), new GH_Path(i, j));

      }

    }

    for( int i = 0; i < intersections.BranchCount; ++i )
    {

      var tempList = intersections.Branch(i);
      var path = new GH_Path(intersections.Path(i).Indices[0]);
      bool temp = false;

      if( tempList.Count > 0 )
      {

        temp = AreaMassProperties.Compute(intersections.Branch(i)[0]).Area < areaIn ? false : true;

        bools.Add(temp, path);

      }

      else
      {

        temp = false;
        bools.Add(temp, path);

      }

    }

    var treeOut = new DataTree<Polyline>();
    var coloursOut = new DataTree<System.Drawing.Color>();
    var rand = new Random();

    for( int i = 0; i < bools.BranchCount; ++i )
    {

      var path = repeated.Path(i);

      coloursOut.Add(System.Drawing.Color.FromArgb(255, rand.Next(0, 255), rand.Next(0, 255), rand.Next(0, 255)), path);

      for( int j = 0; j < bools.Branch(i).Count; ++j )
      {

        if( bools.Branch(i)[j] == true )
        {

          treeOut.Add(repeated.Branch(i)[j], path);

        }

      }

    }

    culledGrid = treeOut;
    colourTree = coloursOut;
# ---------- end c_script ----------
panel = Panel(c_script.culledGrid)
surface = Surface(c_script.culledGrid)
flatten_tree = FlattenTree(Tree=surface, Path="{0}")
list_length = ListLength(List=flatten_tree)
list_length_2 = ListLength(List=crv_2)
custom_preview = CustomPreview(Geometry=surface, Material=c_script.colourTree)
expression = Expression(x=list_length_2, y=list_length, Expression="If( x ≠ y, False, True )")
panel_2 = Panel(expression)
